# Grasshopper definition 20-toronto-envelope.gh (Grasshopper 1.0.8)

# PROMPT
# Use selected Toronto RD rules for a fictional lot.
# Show a translucent blue envelope and a solid house.
# Cap the house by setbacks, height, coverage and FSI.
# 
# ASSUMED: RD(f15)(d0.6), 35% coverage, no HT value.
# CHANGE: lot depth 36 to 30 metres.
lot_width = Slider(15, range=15..21)
lot_depth = Slider(36, range=30..48)
toronto_rd_envelope = TorontoRDEnvelope(lot_width=lot_width, lot_depth=lot_depth)  # -> out, lot, envelope, house, report
# ---------- toronto_rd_envelope: Python ----------
"""Grasshopper Python 3. Inputs: lot_width, lot_depth. Outputs: lot, envelope, house, report.
Prompt: Read the selected Toronto RD rules. Build a lot, the geometric limits,
and a two-storey house capped by setbacks, height, coverage and FSI. Add a lot-depth slider.
"""
import os
import sys
import json
import Rhino.Geometry as rg
folder=os.path.dirname(ghenv.Component.OnPingDocument().FilePath)
if folder not in sys.path:sys.path.insert(0,folder)
if 'zoning_rules' in sys.modules and os.path.dirname(sys.modules['zoning_rules'].__file__)!=folder:
    del sys.modules['zoning_rules']
import importlib
import zoning_rules
importlib.reload(zoning_rules)
from zoning_rules import calculate
c=calculate(lot_width,lot_depth)
w,d=c['lot_width_m'],c['lot_depth_m']
s,f=c['side_setback_m'],c['front_setback_m']
lot=rg.PolylineCurve([rg.Point3d(x,y,0) for x,y in [(0,0),(w,0),(w,d),(0,d),(0,0)]])
envelope=rg.BoundingBox(s,f,0,w-s,f+c['geometric_length_cap_m'],c['flat_roof_height_cap_m']).ToBrep()
hs,hf=c['example_side_setback_m'],c['example_front_setback_m']
house=rg.BoundingBox(hs,hf,0,w-hs,hf+c['example_length_m'],c['example_height_m']).ToBrep()
assert envelope.IsValid and envelope.IsSolid and house.IsValid and house.IsSolid
report=json.dumps(c,indent=2)
ghenv.Component.Message='Lot depth %.1f m / rear %.1f m'%(d,c['rear_setback_m'])
# ---------- end toronto_rd_envelope ----------
lot_outline = CustomPreview(
    Geometry=toronto_rd_envelope.lot,
    Material=[{diffuse=RGB(228, 178, 227), emission=RGB(68, 53, 68), shine=0.5, specular=RGB(255, 254, 255), transparency=0}, {diffuse=RGB(45, 58, 70), emission=RGB(0, 0, 0), shine=0, specular=RGB(255, 255, 255), transparency=0}])
blue_envelope_75_transparent = CustomPreview(
    Geometry=toronto_rd_envelope.envelope,
    Material=[{diffuse=RGB(228, 178, 227), emission=RGB(68, 53, 68), shine=0.5, specular=RGB(255, 254, 255), transparency=0}, {diffuse=RGB(72, 151, 221), emission=RGB(0, 0, 0), shine=0, specular=RGB(255, 255, 255), transparency=0.75}, {diffuse=RGB(72, 151, 221), emission=RGB(0, 0, 0), shine=0, specular=RGB(255, 255, 255), transparency=0.82}])
solid_example_house = CustomPreview(
    Geometry=toronto_rd_envelope.house,
    Material=[{diffuse=RGB(228, 178, 227), emission=RGB(68, 53, 68), shine=0.5, specular=RGB(255, 254, 255), transparency=0}, {diffuse=RGB(216, 125, 78), emission=RGB(0, 0, 0), shine=0, specular=RGB(255, 255, 255), transparency=0}])
panel = Panel(toronto_rd_envelope.report)
